# Grasshopper definition Dome.gh (Grasshopper 0.9.76)

mesh = Mesh(<mesh referenced from the Rhino model>)
xy = XYPlane(Origin=Point(0, 0, 0))
area = Area(Geometry=mesh)  # -> Area, Centroid
project = Project(Geometry=area.Centroid, Plane=xy)  # -> Geometry, Transform
scale = Scale(Geometry=mesh, Center=project.Geometry, Factor=Slider(1.176, range=1..2))  # -> Geometry, Transform
popgeo = PopulateGeometry(Geometry=scale.Geometry, Count=Slider(80, range=0..100), Seed=1)
pdecon = Deconstruct(Point=popgeo)  # -> XComponent, YComponent, ZComponent
larger = LargerThan(FirstNumber=pdecon.ZComponent, SecondNumber=Slider(48, range=0..100))  # -> LargerThan, OrEqualTo
cull = CullPattern(List=popgeo, CullPattern=larger.LargerThan)
pt = Point(flatten(cull))
pdecon_2 = Deconstruct(Point=pt)  # -> graft(XComponent), graft(YComponent), graft(ZComponent)
concat = Concatenate(FragmentA=pdecon_2.XComponent, FragmentB=",")
concat_2 = Concatenate(FragmentA=concat, FragmentB=pdecon_2.YComponent)
concat_3 = Concatenate(FragmentA=concat_2, FragmentB=",")
concat_4 = Concatenate(FragmentA=concat_3, FragmentB=pdecon_2.ZComponent)  # -> flatten(Result)
concat_5 = Concatenate(FragmentA=concat_4, FragmentB="&")  # -> flatten(Result)
panel = Panel(concat_4)
